# Grasshopper definition twisting-pole.gh (Grasshopper 1.0.7)

number_slider_radious = Slider(22.4, range=0..100)
number_slider_height = Slider(6.82, range=0..10)
sections = Slider(9, range=0..10)
count = Slider(47, range=0..100)
radius = GetNumber(number_slider_radious, AtLeast=1, AtMost=1, Maximum=1.797693135e+308, Minimum=-1.797693135e+308)
sections_2 = GetInteger(sections, AtLeast=1, AtMost=1, Maximum=2147483647, Minimum=-2147483648)
total_elevation = GetNumber(number_slider_height, AtLeast=1, AtMost=1, Maximum=1.797693135e+308, Minimum=-1.797693135e+308)
count_2 = GetNumber(count, AtLeast=1, AtMost=1, Maximum=1.797693135e+308, Minimum=-1.797693135e+308)
unit_z = UnitZ(Factor=total_elevation)
polygon = Polygon(Plane=PlaneXY(0, 0, 0), Radius=radius, Segments=sections_2, FilletRadius=0)  # -> Polygon, Length
range = Range(Domain=Domain(0, 1), Steps=expr("x-1", count_2))
min = Slider(0, range=0..700)
max = Slider(237.68, range=0..700)
max_scale = Slider(1.4, range=0.5..2)
min_scale = Slider(0.5, range=0.5..2)
linear_array = LinearArray(Geometry=polygon.Polygon, Direction=unit_z, Count=count_2)  # -> Geometry, Transform
range_2 = Range(Domain=Domain(0, 1), Steps=expr("x-1", count_2))
graph_mapper = GraphMapper(
    range,
    x0=0,
    x1=1,
    y0=0,
    y1=1,
    container_name="Bezier",
    cpx=[0, 0.5571050048, 0.4935563803, 1],
    cpy=[0, 0.1240631342, 0.983482182, 1])
construct_domain = ConstructDomain(DomainStart=min, DomainEnd=max)
graph_mapper_2 = GraphMapper(
    range_2,
    x0=0,
    x1=1,
    y0=0,
    y1=1,
    container_name="Bezier",
    cpx=[0, 0.1231884062, 0.4935563803, 1],
    cpy=[0, 0.2927535772, 0.983482182, 1])
construct_domain_2 = ConstructDomain(DomainStart=min_scale, DomainEnd=max_scale)
point_on_curve = PointOnCurve(linear_array.Geometry, parameter=0)
graph_mapper_3 = GraphMapper(graph_mapper_2, x0=0, x1=1, y0=0, y1=1, container_name="Sine", Equation_px=[0, 0.555087328], Equation_py=[0, 1])
remap_numbers = RemapNumbers(Value=graph_mapper, Source=Domain(0, 1), Target=construct_domain)  # -> Mapped, Clipped
remap_numbers_2 = RemapNumbers(Value=graph_mapper_3, Source=Domain(0, 1), Target=construct_domain_2)  # -> Mapped, Clipped
rotate_3d = Rotate3D(Geometry=linear_array.Geometry, Angle=degrees(remap_numbers.Mapped), Center=point_on_curve, Axis=Vector(0, 0, 1))  # -> Geometry, Transform
scale = Scale(Geometry=rotate_3d.Geometry, Center=point_on_curve, Factor=remap_numbers_2.Mapped)  # -> Geometry, Transform
interpolate = Interpolate(Vertices=point_on_curve, Degree=3, Periodic=False, KnotStyle=1)  # -> Curve, Length, Domain
number_slider = Slider(6.45, range=0..10)
thickness = Slider(2.2, range=0..10)
offset_curve = OffsetCurve(Curve=scale.Geometry, Distance=Slider(10, range=0..10), Plane=PlaneXY(0, 0, 0), Corners=1)
extend_curve = ExtendCurve(Curve=interpolate.Curve, Type=0, Start=number_slider, End=number_slider)
rad = Slider(4.19, range=0..10)
unit_z_2 = UnitZ(Factor=thickness)
surface = Surface(offset_curve)
extrude = Extrude(Base=surface, Direction=unit_z_2)
pipe = Pipe(Curve=extend_curve, Radius=rad, Caps=1)
context_bake = ContextBake(Geometry3Columns=pipe)
solid_difference = SolidDifference(BrepsA=extrude, BrepsB=pipe)  # -> flatten(Result)
brep_edges = BrepEdges(Brep=solid_difference)  # -> Naked, Interior, NonManifold
context_bake_2 = ContextBake(Geometry1Slabs=solid_difference)
deconstruct_brep = DeconstructBrep(Brep=solid_difference)  # -> Faces, Edges, Vertices
get_number = GetNumber(Slider(80.5, range=0..600), AtLeast=1, AtMost=1, Maximum=1.797693135e+308, Minimum=-1.797693135e+308)
list_item = ListItem(List=deconstruct_brep.Faces, Index=0, Wrap=True)  # -> flatten(Item)
unit_x = UnitX(Factor=get_number)
list_length = ListLength(List=list_item)
point = Point(Point(-59.12281928, 47.19098108, 0))
linear_array_2 = LinearArray(Geometry=point, Direction=unit_x, Count=list_length)  # -> Geometry, Transform
plane = Plane(list_item)
orient = Orient(Geometry=list_item, Source=plane, Target=linear_array_2.Geometry)  # -> Geometry, Transform
brep_edges_2 = BrepEdges(Brep=orient.Geometry)  # -> Naked, Interior, NonManifold
area = Area(Geometry=orient.Geometry)  # -> Area, Centroid
series = Series(Start=0, Step=1, Count=list_length)
context_bake_3 = ContextBake(Geometry2Profile=brep_edges_2.Naked)
text_tag_3d = TextTag3D(Location=area.Centroid, Text=series, Size=Slider(7.47, range=0..10), Justification=5)
